# Grasshopper definition corte_laser_topografia_geosampa.gh (Grasshopper 0.9.76)

number_slider = Slider(20, range=0..100)

crv = Curve([<curve referenced from the Rhino model> x23])
Z = UnitZ(Factor=1)
panel = Panel(crv)
lng = ListLength(List=crv)
eval = EvaluateCurve(Curve=crv, Parameter=Z)  # -> Point, Tangent, Angle
pdecon = Deconstruct(Point=eval.Point)  # -> XComponent, YComponent, ZComponent
panel_2 = Panel(pdecon.ZComponent)
project = Project(Geometry=crv, Plane=PlaneXY(0, 0, 0))  # -> Geometry, Transform
item = ListItem(List=project.Geometry, Index=Slider(1, range=0..25), Wrap=True)
number_slider_2 = Slider(1, range=0..25)

crv_2 = Curve([<curve referenced from the Rhino model> x4])
item_2 = ListItem(List=crv_2, Index=0, Wrap=True)
crv_3 = Curve(crv_2)
len = Length(Curve=item_2)
join = JoinCurves(Curves=crv_3, Preserve=False)
series = Series(Start=0, Step=expr("x+10", len), Count=lng)
X = UnitX(Factor=series)
move = Move(Geometry=join, Motion=X)  # -> Geometry, Transform

series_2 = Series(Start=0, Step=expr("x+10", len), Count=lng)
X_2 = UnitX(Factor=series_2)
move_2 = Move(Geometry=project.Geometry, Motion=X_2)  # -> Geometry, Transform

offset = Offset(Curve=move.Geometry, Distance=Slider(0.48, range=0..10), Plane=PlaneXY(0, 0, 0), Corners=1)
graft = GraftTree(Tree=move_2.Geometry, IncludeEmptyLists=True, IncludeNullItems=True)
graft_2 = GraftTree(Tree=offset, IncludeEmptyLists=True, IncludeNullItems=True)
ccx = CurveCurve(CurveA=graft, CurveB=graft_2)  # -> Points, ParamsA, ParamsB
shatter = Shatter(Curve=offset, Parameters=ccx.ParamsB)
item_3 = ListItem(List=shatter, Index=1, Wrap=True)

item_4 = ListItem(List=shatter, Index=Slider(3, range=0..10), Wrap=True)

oval_bounding_curve = Curve(offset)
three_curves = Curve(move_2.Geometry)
graft_3 = GraftTree(Data=three_curves, IncludeEmptyLists=True, IncludeNullItems=True)
ccx_2 = CurveCurve(CurveA=graft_3, CurveB=oval_bounding_curve)  # -> Points, ParamsA, ParamsB
shatter_2 = Shatter(Curve=graft_3, Parameters=ccx_2.ParamsA)
number = Number(0.5)
eval_2 = EvaluateLength(Curve=shatter_2, Length=number, Normalized=True)  # -> Point, Tangent, Parameter
con = Containment(Point=eval_2.Point, Curve=oval_bounding_curve)  # -> Relationship, Point
eval_3 = Evaluate(F="x=2", x=con.Relationship)
dispatch = Dispatch(List=shatter_2, DispatchPattern=eval_3)  # -> ListA, ListB
outside_curves = Curve(dispatch.ListB)
inside_curves = Curve(dispatch.ListA)

crv_4 = Curve(inside_curves)
crv_5 = Curve(item_4)
cull_i = CullIndex(List=crv_5, Indices=Slider(0, range=0..100), Wrap=True)
join_2 = JoinCurves(Curves=flatten([crv_5, crv_4]), Preserve=False)
boundary = BoundarySurfaces(Edges=join_2)

md_slider = MDSlider(
    slider_value=Point(0.5129830497, 0.4496470918, 0.5),
    SliderMode=0,
    x_domain=Domain(0, 1),
    y_domain=Domain(0, 1),
    z_domain=Domain(0, 1))
txt = Text(pdecon.ZComponent)
evalsrf = EvaluateSurface(Surface=reparameterize(boundary), Point=md_slider)  # -> Point, Normal, Frame
lng_2 = ListLength(List=txt)
series_3 = Series(Start=0, Step=1, Count=lng_2)
multiplication = Multiplication(A=series_3, B=Slider(0, range=0..10))
Y = UnitY(Factor=multiplication)
move_3 = Move(Geometry=Y, Motion=evalsrf.Point)  # -> Geometry, Transform
tag = TextTag3D(Location=move_3.Geometry, Text=txt, Size=Slider(3, range=0..10), Justification=7)
