# Grasshopper definition digital desgin practice lab 02_laser cutter programm.gh (Grasshopper 0.9.76)

# UNIDADES EM MILIMETROS!!!!
# Inserir o
# objeto aqui!
surface = Surface()

divide_domain² = DivideDomain²(Domain=surface, UCount=Slider(3, range=0..100), VCount=Slider(21, range=0..100))
# planificador
isotrim = Isotrim(Surface=surface, Domain=divide_domain²)
deconstruct_brep = DeconstructBrep(Brep=isotrim)  # -> Faces, Edges, Vertices
list_item = ListItem(List=deconstruct_brep.Vertices, Index=Slider(0, range=0..100), Wrap=True)
list_item_2 = ListItem(List=deconstruct_brep.Vertices, Index=Slider(1, range=0..100), Wrap=True)
list_item_3 = ListItem(List=deconstruct_brep.Vertices, Index=Slider(2, range=0..100), Wrap=True)
list_item_4 = ListItem(List=deconstruct_brep.Vertices, Index=Slider(3, range=0..100), Wrap=True)
_4point_surface = _4PointSurface(CornerA=list_item, CornerB=list_item_3, CornerC=list_item_4)
_4point_surface_2 = _4PointSurface(CornerA=list_item, CornerB=list_item_2, CornerC=list_item_3)

surface_2 = Surface(flatten([_4point_surface_2, _4point_surface]))

md_slider = MDSlider(
    slider_value=Point(0.3302824059, 0.3994379246, 0.5),
    SliderMode=0,
    x_domain=Domain(0, 1),
    y_domain=Domain(0, 1),
    z_domain=Domain(0, 1))
# texto 3d
evaluate_surface = EvaluateSurface(Surface=reparameterize(surface_2), Point=md_slider)  # -> Point, Normal, Frame
list_length = ListLength(List=evaluate_surface.Point)
series = Series(Start=0, Step=1, Count=list_length)
integer = Integer(series)
text_tag = TextTag(Location=evaluate_surface.Point, Text=integer, Colour=ColourSwatch(SwatchColor=RGB(255, 255, 255)))

# ----
# variável
# de acordo com a escala do obj
number_slider = Slider(58, range=0..1300)
# distribuidor: posiciona as
# peças no plano de corte
orient = Orient(Geometry=surface_2, Source=surface_2, Target=PlaneXY(0, 0, 0))  # -> Geometry, Transform
series_2 = Series(Start=0, Step=number_slider, Count=list_length)
unit_x = UnitX(Factor=series_2)
move = Move(Geometry=orient.Geometry, Motion=unit_x)  # -> Geometry, Transform

# ----
# aba para colagem
deconstruct_brep_2 = DeconstructBrep(Brep=graft(move.Geometry))  # -> Faces, Edges, Vertices
list_item_5 = ListItem(List=deconstruct_brep_2.Edges, Index=0, Wrap=True)  # -> Item, Item1, Item2
largura_da_aba = Slider(3.3, range=0..10)
# variável
# de acordo com a escala do obj
number_slider_2 = Slider(0.5, range=0..1)
offset = Offset(Curve=list_item_5.Item, Distance=largura_da_aba, Plane=PlaneXY(0, 0, 0), Corners=1)
offset_2 = Offset(Curve=list_item_5.Item1, Distance=largura_da_aba, Plane=PlaneXY(0, 0, 0), Corners=1)
offset_3 = Offset(Curve=list_item_5.Item2, Distance=largura_da_aba, Plane=PlaneXY(0, 0, 0), Corners=1)
evaluate_length = EvaluateLength(Curve=offset, Length=number_slider_2, Normalized=True)  # -> Point, Tangent, Parameter
evaluate_length_2 = EvaluateLength(Curve=offset_2, Length=number_slider_2, Normalized=True)  # -> Point, Tangent, Parameter
evaluate_length_3 = EvaluateLength(Curve=offset_3, Length=number_slider_2, Normalized=True)  # -> Point, Tangent, Parameter
number_slider_3 = Slider(0.8, range=0..1)
scale = Scale(Geometry=offset, Center=evaluate_length.Point, Factor=number_slider_3)  # -> Geometry, Transform
scale_2 = Scale(Geometry=offset_2, Center=evaluate_length_2.Point, Factor=number_slider_3)  # -> Geometry, Transform
scale_3 = Scale(Geometry=offset_3, Center=evaluate_length_3.Point, Factor=number_slider_3)  # -> Geometry, Transform
end_points = EndPoints(Curve=scale.Geometry)  # -> Start, End
end_points_2 = EndPoints(Curve=scale_2.Geometry)  # -> Start, End
end_points_3 = EndPoints(Curve=scale_3.Geometry)  # -> Start, End
list_item_6 = ListItem(List=deconstruct_brep_2.Vertices, Index=0, Wrap=True)  # -> Item, Item1, Item2
point = Point(end_points.Start)
point_2 = Point(end_points.End)
point_3 = Point(end_points_2.Start)
point_4 = Point(end_points_2.End)
point_5 = Point(end_points_3.Start)
point_6 = Point(end_points_3.End)
line = Line(StartPoint=point, EndPoint=list_item_6.Item)
line_2 = Line(StartPoint=point_3, EndPoint=list_item_6.Item1)
line_3 = Line(StartPoint=point_5, EndPoint=list_item_6.Item2)
line_4 = Line(StartPoint=point_2, EndPoint=list_item_6.Item1)
line_5 = Line(StartPoint=point_4, EndPoint=list_item_6.Item2)
line_6 = Line(StartPoint=point_6, EndPoint=list_item_6.Item)

# ----
# texto 2d
md_slider_2 = MDSlider(
    slider_value=Point(0.3302824059, 0.3994379246, 0.5),
    SliderMode=0,
    x_domain=Domain(0, 1),
    y_domain=Domain(0, 1),
    z_domain=Domain(0, 1))
evaluate_surface_2 = EvaluateSurface(Surface=reparameterize(move.Geometry), Point=md_slider_2)  # -> Point, Normal, Frame
list_length_2 = ListLength(List=evaluate_surface_2.Point)
series_3 = Series(Start=0, Step=1, Count=list_length_2)
integer_2 = Integer(series_3)

curve = Curve([scale.Geometry, scale_2.Geometry, scale_3.Geometry])
curve_2 = Curve([line, line_2, line_3, line_4, line_5, line_6])
join_curves = JoinCurves(Curves=[curve, curve_2], Preserve=False)

text_tag_3d = TextTag3D(
    Location=evaluate_surface_2.Point,
    Text=integer_2,
    Size=Slider(2.3, range=0..10),
    Colour=ColourSwatch(SwatchColor=RGB(255, 255, 255)),
    Justification=7)
# BAKE IT!!!!!!!
cortar = Curve(join_curves)
gravar = Curve([list_item_5.Item, list_item_5.Item1, list_item_5.Item2])
