# Grasshopper definition estudo 01.gh (Grasshopper 0.9.76)
# plug-ins: Python Interpreter

# ----
# VOLUMETRIA A SER ANALISADA
pavimentos = Slider(23, range=0..100)
limites_da_laje_volume = Curve(reparameterize(<curve referenced from the Rhino model>))
pé_direito = Slider(3.4, range=0..10)
altura_do_edf = Series(Start=Slider(0, range=0..100), Step=pé_direito, Count=pavimentos)
unit_z = UnitZ(Factor=altura_do_edf)
move = Move(Geometry=limites_da_laje_volume, Motion=unit_z)  # -> Geometry, Transform
construct_domain = ConstructDomain(DomainStart=Slider(1, range=-10..10), DomainEnd=Slider(10, range=0..10))
subtraction = Subtraction(A=pavimentos, B=Slider(1, range=0..1))
range = Range(Domain=construct_domain, Steps=subtraction)
area = Area(Geometry=move.Geometry)  # -> Area, Centroid
graph_mapper = GraphMapper(
    range,
    x0=0,
    x1=10,
    y0=0,
    y1=2,
    container_name="Bezier",
    cpx=[0, 0.4537063241, 0.5790204406, 1],
    cpy=[0.34138906, 0.5707247257, 0.7979710102, 0.3798259497])
scale = Scale(Geometry=move.Geometry, Center=area.Centroid, Factor=graph_mapper)  # -> Geometry, Transform
curvas_escalonadas = Curve(scale.Geometry)
area_2 = Area(Geometry=limites_da_laje_volume)  # -> Area, Centroid
unit_z_2 = UnitZ(Factor=1)
line_sdl = LineSDL(Start=area_2.Centroid, Direction=unit_z_2, Length=Slider(50, range=0..100))
series = Series(Start=0, Step=Slider(0.043, range=0..1), Count=pavimentos)
rotate_axis = RotateAxis(Geometry=curvas_escalonadas, Angle=series, Axis=line_sdl)  # -> Geometry, Transform

curve = Curve(rotate_axis.Geometry)
panel = Panel("""-1
-2
-3
-4""")
loft = Loft(
    Curves=rotate_axis.Geometry,
    Options={Adjust=False, Closed=False, LoftEnds=0, LoftSimp=0, LoftType=0, Rebuild=10, Refit=0.01})
cull_index = CullIndex(List=curve, Indices=panel, Wrap=True)
lajes = BoundarySurfaces(Edges=cull_index)
surface = Surface(loft)

divide_domain² = DivideDomain²(Domain=surface, UCount=Slider(9, range=0..100), VCount=Slider(21, range=0..100))
isotrim = Isotrim(Surface=surface, Domain=divide_domain²)
deconstruct_brep = DeconstructBrep(Brep=isotrim)  # -> Faces, Edges, Vertices
list_item = ListItem(List=deconstruct_brep.Vertices, Index=Slider(0, range=0..100), Wrap=True)
list_item_2 = ListItem(List=deconstruct_brep.Vertices, Index=Slider(1, range=0..100), Wrap=True)
list_item_3 = ListItem(List=deconstruct_brep.Vertices, Index=Slider(2, range=0..100), Wrap=True)
list_item_4 = ListItem(List=deconstruct_brep.Vertices, Index=Slider(3, range=0..100), Wrap=True)
_4point_surface = _4PointSurface(CornerA=list_item, CornerB=list_item_3, CornerC=list_item_4)
_4point_surface_2 = _4PointSurface(CornerA=list_item, CornerB=list_item_2, CornerC=list_item_3)

galapagos = Galapagos(fitness=number, gene=[fechado, aberto])

surface_2 = Surface(flatten([_4point_surface_2, _4point_surface]))
deconstruct_brep_2 = DeconstructBrep(Brep=surface_2)  # -> Faces, Edges, Vertices
md_slider = MDSlider(
    slider_value=Point(0.5004406441, 0.5013278868, 0.5),
    SliderMode=0,
    x_domain=Domain(0, 1),
    y_domain=Domain(0, 1),
    z_domain=Domain(0, 1))
evaluate_surface = EvaluateSurface(Surface=reparameterize(deconstruct_brep_2.Faces), Point=md_slider)  # -> Point, Normal, Frame
area_3 = Area(Geometry=deconstruct_brep_2.Faces)  # -> Area, Centroid
aberto = Slider(0.9, range=0.9..1)
fechado = Slider(0.68, range=0.58..0.68)
abertura_dos_vãos = ConstructDomain(DomainStart=aberto, DomainEnd=fechado)
curve_2 = Curve(deconstruct_brep_2.Edges)

number_slider = Slider(1, range=0..1)
downloadepw = Ladybug_downloadEPWWeatherFile(download=Toggle(True))  # -> Output; plug-in component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
open_weather_file = Ladybug_OpenEPWWeatherFile(open=Toggle(True))  # -> epwFile; plug-in component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
panel_2 = Panel(open_weather_file)
ladybug = Ladybug_Ladybug(defaultFolder="C:\ladybug")  # -> out; plug-in component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
importepw = Ladybug_ImportEpw(epwFile=open_weather_file)  # -> Output, latitude, location, dryBulbTemperature, dewPointTemperature, relativeHumidity, windSpeed, windDirection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; plug-in component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
analysisperiod = Ladybug_AnalysisPeriod(
    fromMonth=number_slider,
    fromDay=Slider(2, range=0..10),
    fromHour=Slider(8, range=0..10),
    toMonth=number_slider,
    toDay=Slider(30, range=0..100),
    toHour=Slider(18, range=0..100))  # -> out, analysisPeriod; plug-in component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
gencumulativeskymtx = Ladybug_GenCumulativeSkyMtx(epwFile=open_weather_file, skyDensity=0, useOldRes=True, runIt=Toggle(True))  # -> out, cumulativeSkyMtx; plug-in component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
panel_3 = Panel(ladybug)
cdd_hdd = Ladybug_CDD_HDD(hourlyDryBulbTemperature=importepw.dryBulbTemperature)  # -> out, daily_coolingDegDays, daily_heatingDegDays, monthly_coolingDegDays, monthly_heatingDegDays, annual_coolingDegDays, annual_heatingDegDays; plug-in component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
selectskymtx = Ladybug_selectSkyMtx(
    cumulativeSkyMtx=gencumulativeskymtx.cumulativeSkyMtx,
    analysisPeriod=analysisperiod.analysisPeriod,
    removeDiffuse=False,
    removeDirect=False)  # -> out, selectedSkyMtx; plug-in component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
lajes_2 = Surface(lajes)
flip = Flip(Surface=lajes_2)  # -> Surface, Result
sunpath = Ladybug_SunPath(
    location=importepw.location,
    hour=Slider(12, range=0..100),
    day=Slider(21, range=0..100),
    month=Slider(1, range=0..1),
    timeStep=1,
    sunPathScale=Slider(0.001, range=0..0.001),
    dailyOrAnnualSunPath=True)  # -> out, sunVectors, sunAltitudes, sunAzimuths, port, sunSpheresMesh, sunPathCrvs, legend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; plug-in component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

lady_bug_sun = Vector(sunpath.sunVectors)
angle = Angle(VectorA=evaluate_surface.Normal, VectorB=lady_bug_sun)  # -> Angle, Reflex
panel_4 = Panel(angle.Angle)
remap_numbers = RemapNumbers(Value=angle.Angle, Source=Domain(0, 1), Target=abertura_dos_vãos)  # -> Mapped, Clipped
scale_2 = Scale(Geometry=deconstruct_brep_2.Edges, Center=area_3.Centroid, Factor=remap_numbers.Mapped)  # -> Geometry, Transform
curve_3 = Curve(scale_2.Geometry)
merge = Merge(Data1=graft(curve_3), Data2=graft(curve_2))
loft_2 = Loft(Curves=merge, Options={Adjust=False, Closed=False, LoftEnds=0, LoftSimp=0, LoftType=0, Rebuild=10, Refit=0.01})

fachada = Surface(loft_2)
flip_2 = Flip(Surface=fachada)  # -> Surface, Result
radiationanalysis = Ladybug_RadiationAnalysis(
    north=0,
    geometry=flatten(flip.Surface),
    context=flatten(flip_2.Surface),
    gridSize="5",
    disFromBase="-1",
    selectedSkyMtx=flatten(selectskymtx.selectedSkyMtx),
    runIt=Toggle(True))  # -> out, contextMesh, analysisMesh, testPts, testVec, port, radiationResult, radiationMesh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; plug-in component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

panel_5 = Panel(radiationanalysis.totalRadiation)
number = Number(radiationanalysis.totalRadiation)
