# Grasshopper definition estudo_02_.gh (Grasshopper 0.9.76)
# plug-ins: Python Interpreter, Kangaroo Components, LunchBox

surface = Surface(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)

# ----
# PLANIFICADOR(PEÇAS PLANAS E USINAVEIS)
deconstruct_brep = DeconstructBrep(Brep=surface)  # -> Faces, Edges, Vertices
list_item = ListItem(List=deconstruct_brep.Vertices, Index=1, Wrap=True)
graft_tree = GraftTree(Tree=deconstruct_brep.Edges, IncludeEmptyLists=True, IncludeNullItems=True)
list_item_2 = ListItem(List=deconstruct_brep.Vertices, Index=2, Wrap=True)
list_item_3 = ListItem(List=deconstruct_brep.Vertices, Index=4, Wrap=True)
list_item_4 = ListItem(List=deconstruct_brep.Vertices, Index=3, Wrap=True)
hexagon_cells = HexagonCells(Surface=surface, UDivisions=Slider(6, range=0..100), VDivisions=Slider(5, range=0..100), TParameter=0.25)  # -> HexagonCells, Centers
panel = Panel(graft_tree)
_4point_surface = _4PointSurface(CornerA=list_item, CornerB=list_item_2, CornerC=list_item_4, CornerD=list_item_3)
curve = Curve(hexagon_cells.HexagonCells)
explode = Explode(Curve=curve, Recursive=True)  # -> flatten(Segments), Vertices
panel_2 = Panel(explode.Segments)
removeduplicatelines = RemoveDuplicateLines(Lines=explode.Segments, Tolerance=0.01)
stifness = Slider(0.1, range=0..1)
planarize_strengh = Slider(50, range=0..1000)
curve_strengh = Slider(50, range=0..1000)
control_points = ControlPoints(Curve=hexagon_cells.HexagonCells)  # -> Points, Weights, Knots
flatten_tree = FlattenTree(Tree=control_points.Points, Path="{0}")
length = Length(Curve=removeduplicatelines)
removeduplicatepts = RemoveDuplicatePts(Points=flatten_tree, Tolerance=0.01)
curve_closest_point = CurveClosestPoint(Point=removeduplicatepts, Curve=graft_tree)  # -> Point, Parameter, Distance
equality = Equality(FirstNumber=curve_closest_point.Distance, SecondNumber=0)  # -> Equality, Inequality
cull_pattern = CullPattern(List=curve_closest_point.Point, CullPattern=equality.Equality)
curvepull = CurvePull(Curve=graft_tree, Points=cull_pattern, Strength=curve_strengh)
springsfromline = SpringsFromLine(
    Connection=removeduplicatelines,
    Stiffness=stifness,
    Damping=10,
    RestLength=length,
    UpperCutoff=0,
    LowerCutoff=0,
    Plasticity=0)
planarize = Planarize(Vertices=control_points.Points, Strength=planarize_strengh)
timer = Timer(TimerInterval=20, Target=kangaroophysics)  # disabled
kangaroophysics = KangarooPhysics(
    ForceObjects=flatten([planarize, springsfromline, curvepull]),
    Settings=null,
    Geometry=control_points.Points,
    SimulationReset=Toggle(False))  # -> Out, Iterations, ParticlesOut, GeometryOut

galapagos = Galapagos(fitness=number, gene=[number_slider, number_slider_2])

# ----
# NORMAL AS ABERTURAS
polyline = PolyLine(Vertices=kangaroophysics.GeometryOut, Closed=False)
boundary_surfaces = BoundarySurfaces(Edges=polyline)
surface_2 = Surface(Tree({0;0;0}: [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], {0;0;1}: [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], {0;0;2}: [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], {0;0;3}: [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], {0;0;4}: [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], {0;0;5}: [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]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))
md_slider = MDSlider(
    slider_value=Point(0.5004406441, 0.5013278868, 0.5),
    SliderMode=0,
    x_domain=Domain(0, 1),
    y_domain=Domain(0, 1),
    z_domain=Domain(0, 1))
area = Area(Geometry=boundary_surfaces)  # -> Area, Centroid
evaluate_surface = EvaluateSurface(Surface=reparameterize(boundary_surfaces), Point=md_slider)  # -> Point, Normal, Frame
number_slider = Slider(0.6, range=0.5..1)
number_slider_2 = Slider(0.2, range=0.2..0.7)
construct_domain = ConstructDomain(DomainStart=number_slider, DomainEnd=number_slider_2)
graft_tree_2 = GraftTree(Tree=polyline, IncludeEmptyLists=True, IncludeNullItems=True)

# ----
# ANÁLISES AMBIENTAIS
boolean_toggle = BooleanToggle(True)
downloadepw = Ladybug_downloadEPWWeatherFile(download=boolean_toggle)  # -> Output; plug-in component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
ladybug = Ladybug_Ladybug()  # -> out; plug-in component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
open_weather_file = Ladybug_OpenEPWWeatherFile(open=Toggle(True))  # -> epwFile; plug-in component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
importepw = Ladybug_ImportEpw(epwFile=open_weather_file)  # -> Output, latitude, location, dryBulbTemperature, dewPointTemperature, relativeHumidity, windSpeed, windDirection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; plug-in component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
panel_3 = Panel(ladybug)
point = Point(<point referenced from the Rhino model>)
gencumulativeskymtx = Ladybug_GenCumulativeSkyMtx(epwFile=open_weather_file, skyDensity=0, useOldRes=True, runIt=Toggle(True))  # -> out, cumulativeSkyMtx; plug-in component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
solaradjusttemperature = Ladybug_OutdoorSolarTemperatureAdjustor(
    location=importepw.location,
    cumSkyMtxOrDirNormRad=gencumulativeskymtx.cumulativeSkyMtx,
    port=open_weather_file,
    meanRadTemperature=importepw.dryBulbTemperature,
    bodyPosture=Slider(0, range=0..2),
    rotationAngle=Slider(154, range=0..270),
    bodyLocation=point,
    parallel=Toggle(True),
    runIt=Toggle(True))  # -> readMe, port, effectiveRadiantField, MRTDelta, solarAdjustedMRT, port_2, mannequinMesh, legend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; plug-in component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
analysisperiod = Ladybug_AnalysisPeriod(
    fromMonth=Slider(1, range=0..1),
    fromHour=Slider(8, range=0..10),
    toMonth=Slider(4, range=0..10),
    toHour=Slider(18, range=0..100))  # -> out, analysisPeriod; plug-in component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
selectskymtx = Ladybug_selectSkyMtx(
    cumulativeSkyMtx=gencumulativeskymtx.cumulativeSkyMtx,
    analysisPeriod=analysisperiod.analysisPeriod,
    removeDiffuse=False,
    removeDirect=False)  # -> out, selectedSkyMtx; plug-in component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
panel_4 = Panel(solaradjusttemperature.MRTDelta)
mesh = Mesh(solaradjusttemperature.legend)
panel_5 = Panel(solaradjusttemperature.effectiveRadiantField)
mesh_2 = Mesh(solaradjusttemperature.mannequinMesh)
scale = Scale(Geometry=mesh_2, Center=point, Factor=Slider(0.007, range=0..0.01))  # -> Geometry, Transform
sunpath = Ladybug_SunPath(
    location=importepw.location,
    hour=Slider(12, range=0..100),
    day=Slider(21, range=0..100),
    month=Slider(3, range=0..100),
    timeStep=1,
    sunPathScale=Slider(0.0005, range=0..0.001),
    dailyOrAnnualSunPath=True)  # -> out, sunVectors, sunAltitudes, sunAzimuths, port, sunSpheresMesh, sunPathCrvs, legend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; plug-in component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
curve_2 = Curve(sunpath.sunPathCrvs)
mesh_3 = Mesh()
mesh_4 = Mesh(sunpath.sunSpheresMesh)
unit_x = UnitX(Factor=Slider(38, range=0..100))

vector = Vector(sunpath.sunVectors)
angle = Angle(VectorA=vector, VectorB=evaluate_surface.Normal)  # -> Angle, Reflex
remap_numbers = RemapNumbers(Value=angle.Angle, Source=Domain(0, 1), Target=construct_domain)  # -> Mapped, Clipped
scale_2 = Scale(Geometry=polyline, Center=area.Centroid, Factor=remap_numbers.Mapped)  # -> Geometry, Transform
graft_tree_3 = GraftTree(Tree=scale_2.Geometry, IncludeEmptyLists=True, IncludeNullItems=True)
merge = Merge(Data1=graft_tree_2, Data2=graft_tree_3)
loft = Loft(Curves=merge, Options={Adjust=False, Closed=False, LoftEnds=0, LoftSimp=0, LoftType=0, Rebuild=10, Refit=0.01})

catenaria_peças = Brep(loft)
piso = Surface(reparameterize(_4point_surface))

list_item_5 = ListItem(List=solaradjusttemperature.effectiveRadiantField, Index=7, Wrap=True)
number = Number(list_item_5)

flip = Flip(Surface=piso)  # -> Surface, Result
radiationanalysis = Ladybug_RadiationAnalysis(
    north=0,
    geometry=flatten(flip.Surface),
    context=flatten(catenaria_peças),
    gridSize="2",
    disFromBase="-1",
    selectedSkyMtx=flatten(selectskymtx.selectedSkyMtx),
    runIt=Toggle(True))  # -> out, contextMesh, analysisMesh, testPts, testVec, port, radiationResult, radiationMesh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; plug-in component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
mesh_5 = Mesh(radiationanalysis.radiationMesh)
panel_6 = Panel(radiationanalysis.totalRadiation)
mesh_6 = Mesh(radiationanalysis.radiationLegend)
move = Move(Geometry=mesh_6, Motion=unit_x)  # -> Geometry, Transform

panel_7 = Panel(number)
