# Grasshopper definition heron_work_in_progress_v1.2.gh (Grasshopper 0.9.76)
# plug-ins: Heron, Weaverbird

# ---- group: LOCALIZAÇÃO
esri_rest_service_geocode = ESRIRESTServiceGeocode(Addresses="Praça da Árvore, São Paulo")  # -> Candidates, Latitude, Longitude
panel = Panel(esri_rest_service_geocode.Candidates)
tree_branch = TreeBranch(Tree=esri_rest_service_geocode.Latitude, Path="{0;0}", MaintainPaths=True)
tree_branch_2 = TreeBranch(Tree=esri_rest_service_geocode.Longitude, Path="{0;0}", MaintainPaths=True)
decimal_degrees_to_xy = DecimalDegreesToXY(Latitude=tree_branch, Longitude=tree_branch_2)
panel_2 = Panel(decimal_degrees_to_xy)
set_earthanchorpoint = SetEarthAnchorPoint(SetEAP=Toggle(True), Latitude=esri_rest_service_geocode.Latitude, Longitude=esri_rest_service_geocode.Longitude)

# ---- group: EDIFICAÇÕES
edificações = FilePath("C:\Users\York\Desktop\SHAPEFILE_sp\PROJETO III\SAUDE_EDF.shp")
curve = Curve(<curve referenced from the Rhino model>)
import_shp = ImportSHP(Boundary=curve, ShapefileLocation=edificações)  # -> LayerName, ShpFeatureCount, ShpExtent, ShpSpatRef, Fields, Values, FeaturePoints
panel_3 = Panel(import_shp.Fields)
polyline = PolyLine(Vertices=import_shp.FeaturePoints, Closed=False)
panel_4 = Panel("4")

# ---- group: CURVAS DE NÍVEL
curvas_de_nível = FilePath("C:\Users\York\Desktop\SHAPEFILE_sp\PROJETO III\SAUDE_CURVA MESTRA.shp")
import_shp_2 = ImportSHP(Boundary=curve, ShapefileLocation=curvas_de_nível)  # -> LayerName, ShpFeatureCount, ShpExtent, ShpSpatRef, Fields, Values, FeaturePoints
polyline_2 = PolyLine(Vertices=import_shp_2.FeaturePoints, Closed=False)
list_item = ListItem(List=import_shp_2.Values, Index=0, Wrap=True)  # -> flatten(Item)
multiplication = Multiplication(A=list_item, B=1000)
shift_paths = ShiftPaths(Data=polyline_2, Offset=-1)
unit_z = UnitZ(Factor=multiplication)
move = Move(Geometry=shift_paths, Motion=unit_z)  # -> Geometry, Transform
patch = Patch(Curves=move.Geometry, Spans=20, Flexibility=1, Trim=True)
brep = Brep(patch)

# ---- group: QUADRAS VIÁRIAS
quadra_viária = FilePath("C:\Users\York\Desktop\SHAPEFILE_sp\PROJETO III\SAUDE_QUADRA_VIARIA.shp")
import_shp_3 = ImportSHP(Boundary=curve, ShapefileLocation=quadra_viária)  # -> LayerName, ShpFeatureCount, ShpExtent, ShpSpatRef, Fields, Values, FeaturePoints
polyline_3 = PolyLine(Vertices=import_shp_3.FeaturePoints, Closed=False)
unit_z_2 = UnitZ(Factor=Slider(200, range=0..310))
project = Project(Curve=polyline_3, Brep=brep, Direction=Vector(0, 0, 1))
curve_2 = Curve(project)

# ---- group: EIDFÍCIOS
ruas_quadras_e_edifícios = Curve(polyline)
project_2 = Project(Curve=ruas_quadras_e_edifícios, Brep=brep, Direction=Vector(0, 0, 1))
projeção_do_beiral = Curve(project_2)
explode = Explode(Curve=projeção_do_beiral, Recursive=True)  # -> Segments, Vertices
deconstruct = Deconstruct(Point=explode.Vertices)  # -> XComponent, YComponent, ZComponent
bounds = Bounds(Numbers=deconstruct.ZComponent)
deconstruct_domain = DeconstructDomain(Domain=bounds)  # -> Start, End
construct_point = ConstructPoint(XCoordinate=deconstruct.XComponent, YCoordinate=deconstruct.YComponent, ZCoordinate=deconstruct_domain.Start)
polyline_4 = PolyLine(Vertices=construct_point, Closed=False)
shift_paths_2 = ShiftPaths(Data=polyline_4, Offset=-1)
list_item_2 = ListItem(List=import_shp.Values, Index=panel_4, Wrap=True)
negative = Negative(Value=list_item_2)
boundary_surfaces = BoundarySurfaces(Edges=shift_paths_2)
mesh_brep = MeshBrep(
    Brep=boundary_surfaces,
    Settings={GridMaxCount=0, GridMinCount=16, JaggedSeams=False, MaxEdgeLength=0, MinEdgeLength=0.0001, MinTolerance=0, Refine=True, RefineAngle=0, RelativeTolerance=0.65, SimplePlanes=True, Tolerance=0})
multiplication_2 = Multiplication(A=negative, B=1000)
weaverbird_s_mesh_thicken = WeaverbirdsMeshThicken(MeshCurves=mesh_brep, Distance=multiplication_2, OffsetType=0)
