# Grasshopper definition radiação_visual_sun_path_analysis.gh (Grasshopper 0.9.76)
# plug-ins: Python Interpreter, Human

context_buildings = Brep([<brep referenced from the Rhino model> x17])
context_ground = Brep(<brep referenced from the Rhino model>)
building_to_test = Brep([<brep referenced from the Rhino model> x5])
ground_to_test = Brep(<brep referenced from the Rhino model>)
brep_wireframe = BrepWireframe(Brep=context_ground, Density=-1)
custom_preview = CustomPreview(Geometry=building_to_test, Shader=ColourSwatch(SwatchColor=RGBA(255, 171, 41, 116)))
custom_preview_2 = CustomPreview(Geometry=ground_to_test, Shader=ColourSwatch(SwatchColor=RGBA(173, 255, 0, 98)))
custom_preview_3 = CustomPreview(Geometry=context_buildings, Shader=ColourSwatch(SwatchColor=RGB(38, 37, 38)))
custom_preview_4 = CustomPreview(Geometry=context_ground, Shader=ColourSwatch(SwatchColor=RGB(134, 137, 138)))

ladybug = Ladybug_Ladybug()  # -> Vviiiiiiiiiizzz; plug-in component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

geometry = Geometry([<mesh referenced from the Rhino model> x5000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])
custom_preview_materials = CustomPreviewMaterials(Geometry=geometry, DiffuseColor=ColourSwatch(SwatchColor=RGB(128, 138, 137)), Transparency=Slider(0.2, range=0..1))

point = Point(<point referenced from the Rhino model>)
viewrose = Ladybug_viewRose(context=context_buildings, plane=point, radius=Slider(100, range=0..100))  # -> readMe, viewRose, blocked, visibleAngle; plug-in component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
surface = Surface(viewrose.viewRose)
custom_preview_materials_2 = CustomPreviewMaterials(Geometry=surface, DiffuseColor=ColourSwatch(SwatchColor=RGB(125, 77, 77)), Transparency=Slider(0.7, range=0..1))

panel = Panel(ladybug)

path = FilePath("C:\Users\User\Documents\Estudos\LadyBug_01\BRA_Sao.Paulo.837800_IWEC (1).epw")
importepw = Ladybug_ImportEpw(epwFile=path)  # -> readMe, latitude, location, dryBulbTemperature, dewPointTemperature, relativeHumidity, windSpeed, windDirection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; plug-in component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
conditional_statement = Panel("a<18")
sunpath = Ladybug_SunPath(
    location=importepw.location,
    hour=Slider(10, range=6..18),
    day=Slider(21, range=1..30),
    month=Slider(12, range=1..12),
    timeStep=1,
    sunPathScale=Slider(0.001, range=0..0.001),
    conditionalStatement=conditional_statement,
    dailyOrAnnualSunPath=True)  # -> readMe, sunVectors, sunAltitudes, sunAzimuths, port, sunSpheresMesh, sunPathCrvs, legend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; plug-in component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

geometry_2 = Geometry([context_buildings, building_to_test, context_ground])
mesh = Mesh(sunpath.sunSpheresMesh)
curve = Curve(sunpath.sunPathCrvs)
negative = Negative(Value=Slider(50, range=0..1000))
unit_y = UnitY(Factor=negative)

shadowstudy = Ladybug_ShadowStudy(geometry=geometry_2, sunVector=sunpath.sunVectors)  # -> out, shadow, shade; plug-in component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
explode = Explode(Curve=shadowstudy.shadow, Recursive=True)  # -> flatten(Segments), Vertices
curve_2 = Curve(explode.Segments)
unit_z = UnitZ(Factor=Slider(10, range=0..100))
boundary_surfaces = BoundarySurfaces(Edges=curve_2)
move = Move(Geometry=boundary_surfaces, Motion=unit_z)  # -> Geometry, Transform

move_2 = Move(Geometry=sunpath.legend, Motion=unit_y)  # -> Geometry, Transform

brep = Brep(context_buildings)
number_slider = Slider(4.4, range=0..10)
wires = BrepWireframe(Brep=brep, Density=-1)
ext = ExtendCurve(Curve=wires, Type=0, Start=number_slider, End=number_slider)
preview = CustomPreview(Geometry=ext, Shader=ColourSwatch(SwatchColor=RGB(0, 0, 0)))

# ---- group: test geometry
brep_2 = Brep(building_to_test)

# ----
gencumulativeskymtx = Ladybug_GenCumulativeSkyMtx(epwFile=path, skyDensity=0, useOldRes=True, runIt=Toggle(True))  # -> readMe, cumulativeSkyMtx; plug-in component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
selectskymtx = Ladybug_selectSkyMtx(cumulativeSkyMtx=gencumulativeskymtx.cumulativeSkyMtx, removeDiffuse=False, removeDirect=False)  # -> readMe, selectedSkyMtx; plug-in component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
toggle = BooleanToggle(True)
radiationanalysis = Ladybug_RadiationAnalysis(
    north=0,
    geometry=flatten(brep_2),
    context=flatten(brep),
    gridSize="6",
    disFromBase=".01",
    selectedSkyMtx=flatten(selectskymtx.selectedSkyMtx),
    parallel=toggle,
    runIt=toggle)  # -> readMe, contextMesh, analysisMesh, testPts, testVec, port, radiationResult, radiationMesh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; plug-in component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
negative_2 = Negative(Value=Slider(200, range=0..1000))
unit_y_2 = UnitY(Factor=negative_2)
mesh_2 = Mesh(radiationanalysis.radiationMesh)
move_3 = Move(Geometry=radiationanalysis.radiationLegend, Motion=unit_y_2)  # -> Geometry, Transform
